# Grasshopper definition GH rhinocompute test 1.gh (Grasshopper 1.0.7)
# plug-ins: Heteroptera

count = Slider(10, range=2..20)
count_2 = GetNumber(count, AtLeast=1, AtMost=1, Maximum=1.797693135e+308, Minimum=-1.797693135e+308)

# ----
# create a box
xy = Slider(10.7, range=0..25)
center_box = CenterBox(Base=PlaneXY(0, 0, 0), X=count_2, Y=count_2, Z="0")

surface = Surface(center_box)

# ----
# split the surface with curves
# create random planes from the points
# populate the box with points
seed = Slider(4, range=0..30)
count_3 = Slider(7, range=0..50)
populate_3d = Populate3D(Region=center_box, Count=count_3, Seed=seed)
random_plane = RandomPlane(Origin=populate_3d)
brep_plane = BrepPlane(Brep=center_box, Plane=random_plane)  # -> flatten(Curves), Points
surface_split = SurfaceSplit(Surface=surface, Curves=brep_plane.Curves)

radius = Slider(6, range=5..20)
radius_2 = GetNumber(radius, AtLeast=1, AtMost=1, Maximum=1.797693135e+308, Minimum=-1.797693135e+308)

# ----
# move the centers of trimmed surfaces
# scale trimmed surface
number_slider = Slider(0.83, range=0..10)
area = Area(Geometry=surface_split)  # -> Area, Centroid
construct_domain = ConstructDomain(DomainStart=Slider(2.42, range=0..10), DomainEnd=radius_2)
list_length = ListLength(List=area.Area)
remap_numbers = RemapNumbers(Value=area.Area, Source=list_length, Target=construct_domain)  # -> Mapped, Clipped
number_slider_2 = Slider(1.02, range=0..2)
unit_z = UnitZ(Factor=remap_numbers.Mapped)
multiplication = Multiplication(A=unit_z, B=number_slider_2)
curve = Curve(surface_split)
scale = Slider(0.22, range=0..1)
move = Move(Geometry=curve, Motion=multiplication)  # -> Geometry, Transform
scale_2 = Scale(Geometry=move.Geometry, Center=area.Centroid, Factor=scale)  # -> Geometry, Transform

# ----
# create a lofted surface from
# curves of trimmed surfaces
panel = Panel("""0
1""")
weave = Weave(Pattern=panel, Stream0=curve, Stream1=scale_2.Geometry, NullGaps=False)
partition_list = PartitionList(List=weave, Size="2")
loft = Loft(Curves=partition_list, Options={Adjust=False, Closed=False, LoftEnds=0, LoftSimp=0, LoftType=0, Rebuild=10, Refit=0.01})

debrep = DeconstructBrep(Brep=loft)  # -> Faces, Edges, Vertices
brep_edges = BrepEdges(Brep=loft)  # -> Naked, Interior, NonManifold
panel_2 = Panel(debrep.Faces)
panel_3 = Panel(loft)

# ---- group: RH_OUT:edges
custom_preview = CustomPreview(Geometry=brep_edges.Interior, Material=ColourSwatch(SwatchColor=RGB(24, 35, 48)))

# ----
flatten = FlattenTree(Tree=debrep.Faces, Path="{0}")
mesh = MeshBrep(
    Brep=flatten,
    Settings={GridMaxCount=0, GridMinCount=16, JaggedSeams=False, MaxEdgeLength=0, MinEdgeLength=0.0001, MinTolerance=0, Refine=True, RefineAngle=0, RelativeTolerance=0.65, SimplePlanes=True, Tolerance=0})
panel_4 = Panel(mesh)
area_2 = Area(Geometry=debrep.Faces)  # -> Area, Centroid
flatten_2 = FlattenTree(Tree=area_2.Area, Path="{0}")
c_script = CSharpScript(mesh=mesh, Area=flatten_2)  # -> out, A; inputs mesh: Mesh, Area: String
# ---------- c_script: C# ----------
    //var c = color.R + "," + color.G + "," + color.B;
    _mesh.SetUserString("Area", Area);
    A = _mesh;
# ---------- end c_script ----------

# ---- group: RH_OUT:mesh
mesh_2 = Mesh(c_script.A)

# ----
panel_5 = Panel(flatten_2)
panel_6 = Panel(flatten)
custom_preview_2 = CustomPreview(Geometry=mesh_2, Material=ColourSwatch(SwatchColor=RGB(135, 215, 255)))
flatten_3 = FlattenTree(Tree=debrep.Edges, Path="{0}")  # disabled
curvepoint = PointOnCurve(flatten_3, parameter=0.5)  # disabled
pt = ConstructPoint(XCoordinate=0, YCoordinate=0, ZCoordinate=0)  # disabled
pull = PullPoint(Point=curvepoint, Geometry=pt, ClosestOnly=True)  # -> ClosestPoint, Distance; disabled
bnd = Bounds(Numbers=pull.Distance)  # disabled
remap = RemapNumbers(Value=pull.Distance, Source=bnd, Target=Domain(0, 1))  # -> Mapped, Clipped; disabled
gradient = Gradient(
    LowerLimit=0,
    UpperLimit=1,
    Parameter=remap.Mapped,
    stops=[0: RGB(0, 34, 255), 0.5: RGB(255, 0, 85), 1: RGB(255, 153, 0)])  # disabled
c_script_2 = CSharpScript(crv=flatten_3, color=gradient)  # -> out, A; inputs crv: Curve, color: Color; disabled
# ---------- c_script_2: C# ----------
    var c = color.R + "," + color.G + "," + color.B;
    crv.SetUserString("color", c);
    A = crv;
# ---------- end c_script_2 ----------

# ---- group: RH_OUT:edges
curve_2 = Curve(flatten(c_script_2.A))  # disabled
